# Grasshopper definition what.gh (Grasshopper 1.0.7)

get_point = GetPoint(AtLeast=1, AtMost=1, Realtime=True)
offset_distance = Slider(2, range=1..5)

# ---- group: Create central spline curve
pt = Point(get_point)
nurbs = NurbsCurve(Vertices=pt, Degree=2, Periodic=False)  # -> Curve, Length, Domain

# ----
subtraction = Subtraction(A=0, B=offset_distance)
segments = Slider(15, range=10..50)

# ---- group: Offset curve in both directions
# ← This double-dashed wire means that
#     more than one list of values is flowing
#     through it. Solid wires represent single
#     values, double wires represent a single
#     list of at least two values.
offset = OffsetCurve(Curve=nurbs.Curve, Distance=[offset_distance, subtraction], Plane=PlaneXY(0, 0, 0), Corners=1)

# ---- group: Divide curve and transfer points to offset curves
divide = DivideCurve(Curve=nurbs.Curve, Count=segments, Kinks=False)  # -> Points, Tangents, Parameters
crv_cp = CurveClosestPoint(Point=divide.Points, Curve=offset)  # -> Point, Parameter, Distance

# ----
get_geometry = GetGeometry(AtLeast=1, AtMost=1, DeleteInput=False, Filter=1074004029)
# Geometry can be 'referenced' from Rhino.
# While referenced, it will update in Grasshopper
# whenever the original object changes. However
# once 'internalised' (via the menu) geometry
# becomes a permanent part of the gh file.
# This (        ) surface was made by hand in
# Rhino, then referenced and finally internalised.
srf = Surface(get_geometry)

# ---- group: Project points to surface
# Grasshopper can treat lines and planes as
# infinitely long/large objects if warranted.
# This allows us to find the intersection of a
# line and a surface, even when the two do
# not physically touch.
line = LineSDL(Start=crv_cp.Point, Direction=Vector(0, 0, 1), Length=10)
blx = BrepLine(Brep=srf, Line=line, LimitToFirst=True, UseTasks=True)  # -> Curves, Points

# ---- group: Create a horizontal plane at a specific elevation
xy = XYPlane(Origin=Point(0, 0, 0))
pl_offset = PlaneOffset(BasePlane=xy, Offset=Slider(10, range=10..25))

# ---- group: Project points to plane
project = Project(Geometry=blx.Points, Plane=pl_offset)  # -> Geometry, Transform

# ---- group: Create columns
ln = Line(StartPoint=project.Geometry, EndPoint=blx.Points)

# ---- group: Create arches
# Connecting the tops of each pair of columns with an arch
# requires that we first organise our data into pairs. Because
# right now the points are organised in two lists of many
# points (one list for the left offset curve, and one for the right).
# The FLIP MATRIX component will modify our data structure
# so that instead of 2 lists of N points, we will get N lists of 2
# points. This then allows us to select the first and second
# point in each list and use them as the end-points for our arcs.
flip = FlipMatrix(Data=project.Geometry)
item = ListItem(List=flip, Index=0, Wrap=True)  # -> Item, Item1
arc = ArcSED(Start=item.Item, End=item.Item1, Direction=Vector(0, 0, 1))  # -> Arc, Plane, Radius

# ----
merge = Merge(Data1=arc.Arc, Data2=ln)
context_bake = ContextBake(Geometry=merge)
